# Dynamo graph ifc2dyn_1.dyn (Dynamo 2.12.1.8246)

file_path = Filename("E:\Temp\Знаки_индор.ifc")
ifcDoc = ifc2dyn.IfcDoc.IfcDoc(PathToFile=file_path)
ifcSharedBldgElements_enities = ifc2dyn.IfcDoc.IfcSharedBldgElements_enities(ifcDoc=ifcDoc)
ifcElementInfo = ifc2dyn.IfcElementInfo.IfcElementInfo(input_element=ifcSharedBldgElements_enities.IfcBuildingElementProxy)
info = ifc2dyn.IfcElementInfo.info(ifcElementInfo=ifcElementInfo)
getElements = ifc2dyn.IfcDoc.GetElements(ifcDoc=ifcDoc)
